# Grasshopper definition Bagels_001.gh (Grasshopper 1.0.7)

number_slider = Slider(3, range=0..10)
number_slider_2 = Slider(7, range=0..9)
number_slider_3 = Slider(7, range=0..9)
number_slider_4 = Slider(9, range=0..9)
secretnum = GhPythonScript(NUM_DIGITS=number_slider)  # -> out, a; inputs NUM_DIGITS: Int32
# ---------- secretnum: Python ----------
"""Bagels, by Al Sweigart al@inventwithpython.com
A deductive logic game where you must guess a number based on clues.
This code is available at https://nostarch.com/big-book-small-python-programming
A version of this game is featured in the book, "Invent Your Own
Computer Games with Python" https://nostarch.com/inventwithpython
Tags: short, game, puzzle"""

import random


"""Returns a string made up of NUM_DIGITS unique random digits."""
numbers = list('0123456789')  # Create a list of digits 0 to 9.
random.shuffle(numbers)  # Shuffle them into random order.

# Get the first NUM_DIGITS digits in the list for the secret number:
secretNum = ''
for i in range(NUM_DIGITS):
    secretNum += str(numbers[i])
print(secretNum)
# ---------- end secretnum ----------
concatenate = Concatenate(hundreds=number_slider_4, tens=number_slider_3, ones=number_slider_2)
concatenate_2 = Concatenate(hundreds=number_slider_4, tens=number_slider_3, ones=number_slider_2)
concatenate_3 = Concatenate(hundreds=number_slider_4, tens=number_slider_3, ones=number_slider_2)
concatenate_4 = Concatenate(hundreds=number_slider_4, tens=number_slider_3, ones=number_slider_2)
concatenate_5 = Concatenate(hundreds=number_slider_4, tens=number_slider_3, ones=number_slider_2)
concatenate_6 = Concatenate(hundreds=number_slider_4, tens=number_slider_3, ones=number_slider_2)
fermipicobagels = GhPythonScript(
    secretNum=secretnum.out,
    NUM_DIGITS=number_slider,
    MAX_GUESSES=Slider(3, range=1..6),
    your_Guess1=concatenate_2,
    your_Guess2=concatenate,
    your_Guess3=concatenate_3,
    your_Guess4=concatenate_4,
    your_Guess5=concatenate_5,
    your_Guess6=concatenate_6)  # -> out, a; inputs NUM_DIGITS: Int32, MAX_GUESSES: Int32
# ---------- fermipicobagels: Python ----------
"""Bagels, by Al Sweigart al@inventwithpython.com
A deductive logic game where you must guess a number based on clues.
This code is available at https://nostarch.com/big-book-small-python-programming
A version of this game is featured in the book, "Invent Your Own
Computer Games with Python" https://nostarch.com/inventwithpython
Tags: short, game, puzzle"""

import random

#NUM_DIGITS = 3  # (!) Try setting this to 1 or 10.
#MAX_GUESSES = 10  # (!) Try setting this to 1 or 100.


def main():
    print('''Bagels, a deductive logic game.
By Al Sweigart al@inventwithpython.com

I am thinking of a {}-digit number with no repeated digits.
Try to guess what it is. Here are some clues:
When I say:    That means:
  Pico         One digit is correct but in the wrong position.
  Fermi        One digit is correct and in the right position.
  Bagels       No digit is correct.

For example, if the secret number was 248 and your guess was 843, the
clues would be Fermi Pico.'''.format(NUM_DIGITS))

    while True:  # Main game loop.
        # This stores the secret number the player needs to guess:
        #secretNum = getSecretNum()
        print('I have thought up a number.')
        print(' You have {} guesses to get it.'.format(MAX_GUESSES))

        numGuesses = 1
        while numGuesses <= MAX_GUESSES:
            guess = ''
            # Keep looping until they enter a valid guess:
            while len(guess) != NUM_DIGITS or not guess.isdecimal():
                print('Guess #{}: '.format(numGuesses))
                if numGuesses == 1:
                    guess = your_Guess1
                elif numGuesses == 2:
                    guess = your_Guess2
                elif numGuesses == 3:
                    guess = your_Guess3
                elif numGuesses == 4:
                    guess = your_Guess4
                elif numGuesses == 5:
                    guess = your_Guess5
                else:
                    guess = your_Guess6

            clues = getClues(guess, secretNum)
            print(clues)
            numGuesses += 1

            if guess == secretNum:
                break  # They're correct, so break out of this loop.
            if numGuesses > MAX_GUESSES:
                print('You ran out of guesses.')
                print('The answer was {}.'.format(secretNum))

        # Ask player if they want to play again.
        print('Do you want to play again? (yes or no)')
        if not your_Guess1.lower().startswith('y'):
            break
    print('Thanks for playing!')


def getClues(guess, secretNum):
    """Returns a string with the pico, fermi, bagels clues for a guess
    and secret number pair."""
    if guess == secretNum:
        return 'You got it!'

    clues = []

    for i in range(len(guess)):
        if guess[i] == secretNum[i]:
            # A correct digit is in the correct place.
            clues.append('Fermi')
        elif guess[i] in secretNum:
            # A correct digit is in the incorrect place.
            clues.append('Pico')
    if len(clues) == 0:
        return 'Bagels'  # There are no correct digits at all.
    else:
        # Sort the clues into alphabetical order so their original order
        # doesn't give information away.
        clues.sort()
        # Make a single string from the list of string clues.
        return ' '.join(clues)


# If the program is run (instead of imported), run the game:
if __name__ == '__main__':
    main()
# ---------- end fermipicobagels ----------
panel = Panel(secretnum.out)
panel_2 = Panel(fermipicobagels.out)
